# Grasshopper definition TASK2 SCRIPT.gh (Grasshopper 0.9.76)

num = Number(expr("x*100", [4, 3, 1, 2, 0, 0, 1]))
panel = Panel(num)
num_2 = Number(expr("x*250", [0.5, 0.5, 3, 2, 2, 3, 1]))
panel_2 = Panel(num_2)
num_3 = Number(expr("x*100", [3, 4.5, 5, 4.5, 3, 3, 3, 2, 0, 2, 3]))
panel_3 = Panel(num_3)
num_4 = Number(expr("x*200", [2, 1, 1, 1.5, 0.5, 2, 2, 1, 0.5, 0.5, 3]))
panel_4 = Panel(num_4)
pt = ConstructPoint(XCoordinate=0, YCoordinate=num, ZCoordinate=0)
X = UnitX(Factor=1)
pt_2 = ConstructPoint(XCoordinate=0, YCoordinate=num_3, ZCoordinate=0)
X_2 = UnitX(Factor=1)
ma = MassAddition(Input=num_2)  # -> Result, PartialResults
ma_2 = MassAddition(Input=num_4)  # -> Result, PartialResults
line = LineSDL(Start=pt, Direction=X, Length=num_2)
line_2 = LineSDL(Start=pt_2, Direction=X_2, Length=num_4)
domain = Domain(Domain(0, 5))
domain_2 = Domain(Domain(0, 9))
number_slider = Slider(0, range=0..100)
subset = SubList(List=ma.PartialResults, Domain=domain, Wrap=True)  # -> List, Index
number_slider_2 = Slider(0, range=0..100)
subset_2 = SubList(List=ma_2.PartialResults, Domain=domain_2, Wrap=True)  # -> List, Index
ins = InsertItems(List=subset.List, Item=number_slider, Indices=number_slider, Wrap=True)
ins_2 = InsertItems(List=subset_2.List, Item=number_slider_2, Indices=number_slider_2, Wrap=True)
panel_5 = Panel(ins)
X_3 = UnitX(Factor=ins)
X_4 = UnitX(Factor=ins_2)
move = Move(Geometry=line, Motion=X_3)  # -> Geometry, Transform
move_2 = Move(Geometry=line_2, Motion=X_4)  # -> Geometry, Transform
num_5 = Number([0, 4, 5])
panel_6 = Panel(num_5)
num_6 = Number([1, 3, 6, 7, 9, 10])
num_7 = Number([2, 8])
item = ListItem(List=move_2.Geometry, Index=num_5, Wrap=True)
item_2 = ListItem(List=move_2.Geometry, Index=num_6, Wrap=True)
item_3 = ListItem(List=move_2.Geometry, Index=num_7, Wrap=True)
num_8 = Number(5)
num_9 = Number([0, 1, 2])
num_10 = Number(6)
num_11 = Number([3, 4])
number_slider_3 = Slider(150, range=0..1000)
number_slider_4 = Slider(0, range=0..1000, expression="450")
number_slider_5 = Slider(300, range=0..1000)
item_4 = ListItem(List=move.Geometry, Index=num_8, Wrap=True)
item_5 = ListItem(List=move.Geometry, Index=num_9, Wrap=True)
item_6 = ListItem(List=move.Geometry, Index=num_10, Wrap=True)
item_7 = ListItem(List=move.Geometry, Index=num_11, Wrap=True)
neg = Negative(Value=number_slider_3)
neg_2 = Negative(Value=number_slider_5)
neg_3 = Negative(Value=number_slider_4)
number_slider_6 = Slider(0, range=0..1000, expression="400")
number_slider_7 = Slider(0, range=0..1000, expression="500")
Z = UnitZ(Factor=number_slider_3)  # -> graft(UnitVector)
number_slider_8 = Slider(0, range=0..1000, expression="250")
number_slider_9 = Slider(0, range=0..1000, expression="600")
Z_2 = UnitZ(Factor=neg)  # -> graft(UnitVector)
Z_3 = UnitZ(Factor=number_slider_4)  # -> graft(UnitVector)
Z_4 = UnitZ(Factor=number_slider_5)  # -> graft(UnitVector)
Z_5 = UnitZ(Factor=neg_2)  # -> graft(UnitVector)
Z_6 = UnitZ(Factor=neg_3)  # -> graft(UnitVector)
extr = Extrude(Base=item_3, Direction=Z_2)
extr_2 = Extrude(Base=item_3, Direction=Z)
neg_4 = Negative(Value=number_slider_6)
extr_3 = Extrude(Base=item_2, Direction=Z_5)
extr_4 = Extrude(Base=item_2, Direction=Z_4)
neg_5 = Negative(Value=number_slider_7)
extr_5 = Extrude(Base=item, Direction=Z_3)
neg_6 = Negative(Value=number_slider_8)
extr_6 = Extrude(Base=item, Direction=Z_6)
neg_7 = Negative(Value=number_slider_9)
Z_7 = UnitZ(Factor=number_slider_6)  # -> graft(UnitVector)
Z_8 = UnitZ(Factor=number_slider_7)  # -> graft(UnitVector)
Z_9 = UnitZ(Factor=number_slider_8)  # -> graft(UnitVector)
Z_10 = UnitZ(Factor=number_slider_9)  # -> graft(UnitVector)
Z_11 = UnitZ(Factor=neg_4)  # -> graft(UnitVector)
Z_12 = UnitZ(Factor=neg_5)  # -> graft(UnitVector)
Z_13 = UnitZ(Factor=neg_6)  # -> graft(UnitVector)
Z_14 = UnitZ(Factor=neg_7)  # -> graft(UnitVector)
extr_7 = Extrude(Base=item_4, Direction=Z_7)
extr_8 = Extrude(Base=item_4, Direction=Z_11)
extr_9 = Extrude(Base=item_5, Direction=Z_8)
extr_10 = Extrude(Base=item_6, Direction=Z_9)
extr_11 = Extrude(Base=item_5, Direction=Z_12)
extr_12 = Extrude(Base=item_7, Direction=Z_10)
extr_13 = Extrude(Base=item_6, Direction=Z_13)
extr_14 = Extrude(Base=item_7, Direction=Z_14)
brep = Brep([extr_4, extr_5, extr_6, extr_3, extr_2, extr])
brep_2 = Brep([extr_9, extr_11, extr_12, extr_14, extr_7, extr_8, extr_10, extr_13])
join = BrepJoin(Breps=brep_2)  # -> Breps, Closed
join_2 = BrepJoin(Breps=brep)  # -> Breps, Closed
Y = UnitY(Factor=1)
Z_15 = UnitZ(Factor=1)
rotate = Rotate(Geometry=[join.Breps, join_2.Breps], Center=Point(0, 0, 0), From=Y, To=Z_15)  # -> Geometry, Transform
