# Grasshopper definition fieldlinesfailed.gh (Grasshopper 0.9.76)

rectangle = Rectangle(Plane=PlaneXY(0, 0, 0), XSize=Slider(20, range=0..100), YSize=Slider(20, range=0..100), Radius=0)  # -> Rectangle, Length
invisible = Point([<point referenced from the Rhino model> x4])
visible = Point([<point referenced from the Rhino model> x3])
pt = Point([<point referenced from the Rhino model> x3])
pcharge = PointCharge(
    Point=flatten([visible, invisible]),
    Charge=Slider(4.9, range=0..10),
    Decay=Slider(1.5, range=0..10),
    Bounds=rectangle.Rectangle)
fspin = SpinForce(
    Plane=pt,
    Strength=Slider(9.6, range=0..10),
    Radius=Slider(10, range=0..10),
    Decay=Slider(2, range=0..10),
    Bounds=rectangle.Rectangle)
cir = Circle(Plane=visible, Radius=Slider(0.064, range=0..0.1))
mergef = MergeFields(Fields=[fspin, pcharge])
divide = DivideCurve(Curve=cir, Count=Slider(28, range=0..100), Kinks=False)  # -> flatten(Points), Tangents, Parameters
fline = FieldLine(Field=mergef, Point=divide.Points, Steps=Slider(435, range=0..1000), Accuracy=0.1, Method=3)
