# Grasshopper definition yLi_GH.gh (Grasshopper 0.9.76)

# This box represents the boundary of the field calculation. You did not have it set to cover the site.
# I've se it so that its big enough.
number_slider = Slider(41, range=0..100)
rectangle = Rectangle(Plane=PlaneXY(0, 0, 0), XSize=Slider(44, range=0..100), YSize=number_slider, Radius=0)  # -> Rectangle, Length
xy = XYPlane(Origin=Point(0, 0, 0))
crv = Curve(<curve referenced from the Rhino model>)
invisible = Point(<point referenced from the Rhino model>)
visible = Point([<point referenced from the Rhino model> x3])
project = Project(Geometry=crv, Plane=xy)  # -> Geometry, Transform
area = Area(Geometry=project.Geometry)  # -> Area, Centroid
pt = Point([<point referenced from the Rhino model> x3])
number_slider_2 = Slider(100, range=0..100)
pcharge = PointCharge(
    Point=flatten([visible, invisible]),
    Charge=Slider(18, range=0..1000),
    Decay=Slider(2, range=0..10),
    Bounds=rectangle.Rectangle)
fspin = SpinForce(
    Plane=pt,
    Strength=Slider(6, range=0..1000),
    Radius=Slider(2, range=0..1000),
    Decay=Slider(1, range=0..10),
    Bounds=rectangle.Rectangle)
crv_2 = Curve(<curve referenced from the Rhino model>)
cir = Circle(Plane=visible, Radius=Slider(1.5, range=0..1000))
mergef = MergeFields(Fields=[fspin, pcharge])
line = LineSDL(Start=area.Centroid, Direction=crv_2, Length=Slider(4, range=0..6))
divide = DivideCurve(Curve=cir, Count=Slider(8, range=0..100), Kinks=False)  # -> flatten(Points), Tangents, Parameters
divide_2 = DivideCurve(Curve=line, Count=number_slider_2, Kinks=False)  # -> Points, Tangents, Parameters
vec2pt = Vector2Pt(PointA=area.Centroid, PointB=divide_2.Points, Unitize=False)  # -> Vector, Length
fline = FieldLine(Field=mergef, Point=divide.Points, Steps=Slider(2000, range=0..10000), Accuracy=0.1, Method=3)  # -> graft(Curve)
pt_2 = Point(divide_2.Points)
hframe = HorizontalFrame(Curve=line, Parameter=divide_2.Parameters)
panel = Panel(fline)
amp = Amplitude(Vector=vec2pt.Vector, Amplitude=vec2pt.Length)
range = Range(Domain=Slider(71, range=0..100), Steps=number_slider_2)
range_2 = Range(Domain=Slider(0.43, range=0..1), Steps=number_slider_2)
reb = RebuildCurve(Curve=fline, Degree=3, Count=7, Tangents=False)
rad = Radians(Degrees=range)
move = Move(Geometry=crv, Motion=amp)  # -> Geometry, Transform
panel_2 = Panel(reb)
multiplication = Multiplication(A=range_2, B=Slider(23, range=0..60))
crv_3 = Curve([<curve referenced from the Rhino model> x24])
rot3d = Rotate3D(Geometry=move.Geometry, Angle=rad, Center=pt_2, Axis=hframe)  # -> Geometry, Transform
cp = ControlPoints(Curve=crv_3)  # -> Points, Weights, Knots
sin = Sine(Value=multiplication)
subtraction = Subtraction(A=Slider(2.1, range=0..10), B=sin)
nurbs = NurbsCurve(Vertices=cp.Points, Degree=3, Periodic=False)  # -> Curve, Length, Domain
scale = Scale(Geometry=rot3d.Geometry, Center=pt_2, Factor=subtraction)  # -> Geometry, Transform
loft = Loft(Curves=scale.Geometry, Options={Adjust=False, Closed=False, LoftEnds=0, LoftSimp=0, LoftType=1, Rebuild=10, Refit=0.01})
crv_4 = Curve(<curve referenced from the Rhino model>)
crv_5 = Curve(<curve referenced from the Rhino model>)
crv_6 = Curve(<curve referenced from the Rhino model>)
crv_7 = Curve(<curve referenced from the Rhino model>)
crv_8 = Curve(<curve referenced from the Rhino model>)
crv_9 = Curve(<curve referenced from the Rhino model>)
cluster = Cluster(num=0.4, crv_2=crv_4, L=nurbs.Curve, crv=nurbs.Curve)
cluster_2 = Cluster(num=0.4, crv_2=crv_5, L=nurbs.Curve, crv=nurbs.Curve)
cluster_3 = Cluster(num=0.4, crv_2=crv_9, L=nurbs.Curve, crv=nurbs.Curve)
cluster_4 = Cluster(num=0.4, crv_2=crv_7, L=nurbs.Curve, crv=nurbs.Curve)
cluster_5 = Cluster(num=0.4, crv_2=crv_6, L=nurbs.Curve, crv=nurbs.Curve)
cluster_6 = Cluster(num=0.4, crv_2=crv_8, L=nurbs.Curve, crv=nurbs.Curve)
domain = Domain(Domain(1, 3))
domain_2 = Domain(Domain(1, 3))
domain_3 = Domain(Domain(1, 3))
domain_4 = Domain(Domain(1, 3))
domain_5 = Domain(Domain(1, 3))
domain_6 = Domain(Domain(1, 3))
subset = SubList(List=cluster, Domain=domain, Wrap=True)  # -> graft(List), Index
subset_2 = SubList(List=cluster_5, Domain=domain_3, Wrap=True)  # -> graft(List), Index
subset_3 = SubList(List=cluster_2, Domain=domain_2, Wrap=True)  # -> graft(List), Index
subset_4 = SubList(List=cluster_6, Domain=domain_4, Wrap=True)  # -> graft(List), Index
subset_5 = SubList(List=cluster_3, Domain=domain_5, Wrap=True)  # -> graft(List), Index
subset_6 = SubList(List=cluster_4, Domain=domain_6, Wrap=True)  # -> graft(List), Index
Z = UnitZ(Factor=Slider(0.4, range=0..1))
Z_2 = UnitZ(Factor=Slider(0.4, range=0..1))
Z_3 = UnitZ(Factor=Slider(0.4, range=0..1))
Z_4 = UnitZ(Factor=Slider(0.4, range=0..1))
Z_5 = UnitZ(Factor=Slider(0.4, range=0..1))
Z_6 = UnitZ(Factor=Slider(0.4, range=0..1))
move_2 = Move(Geometry=cluster, Motion=Z)  # -> Geometry, Transform
move_3 = Move(Geometry=cluster_5, Motion=Z_2)  # -> Geometry, Transform
move_4 = Move(Geometry=cluster_2, Motion=Z_3)  # -> Geometry, Transform
move_5 = Move(Geometry=cluster_6, Motion=Z_4)  # -> Geometry, Transform
move_6 = Move(Geometry=cluster_3, Motion=Z_5)  # -> Geometry, Transform
move_7 = Move(Geometry=cluster_4, Motion=Z_6)  # -> Geometry, Transform
domain_7 = Domain(Domain(0, 2))
domain_8 = Domain(Domain(0, 2))
domain_9 = Domain(Domain(0, 2))
domain_10 = Domain(Domain(0, 2))
domain_11 = Domain(Domain(0, 2))
domain_12 = Domain(Domain(0, 2))
subset_7 = SubList(List=move_2.Geometry, Domain=domain_7, Wrap=True)  # -> graft(List), Index
subset_8 = SubList(List=move_3.Geometry, Domain=domain_9, Wrap=True)  # -> graft(List), Index
subset_9 = SubList(List=move_4.Geometry, Domain=domain_8, Wrap=True)  # -> graft(List), Index
subset_10 = SubList(List=move_5.Geometry, Domain=domain_10, Wrap=True)  # -> graft(List), Index
subset_11 = SubList(List=move_6.Geometry, Domain=domain_11, Wrap=True)  # -> graft(List), Index
subset_12 = SubList(List=move_7.Geometry, Domain=domain_12, Wrap=True)  # -> graft(List), Index
loft_2 = Loft(
    Curves=[subset_8.List, subset_2.List],
    Options={Adjust=False, Closed=False, LoftEnds=0, LoftSimp=0, LoftType=0, Rebuild=10, Refit=0.01})
extr = Extrude(Base=cluster_5, Direction=Z_2)
loft_3 = Loft(
    Curves=[subset_9.List, subset_3.List],
    Options={Adjust=False, Closed=False, LoftEnds=0, LoftSimp=0, LoftType=0, Rebuild=10, Refit=0.01})
extr_2 = Extrude(Base=cluster_2, Direction=Z_3)
extr_3 = Extrude(Base=cluster, Direction=Z)
loft_4 = Loft(
    Curves=[subset_7.List, subset.List],
    Options={Adjust=False, Closed=False, LoftEnds=0, LoftSimp=0, LoftType=0, Rebuild=10, Refit=0.01})
loft_5 = Loft(
    Curves=[subset_10.List, subset_4.List],
    Options={Adjust=False, Closed=False, LoftEnds=0, LoftSimp=0, LoftType=0, Rebuild=10, Refit=0.01})
extr_4 = Extrude(Base=cluster_6, Direction=Z_4)
loft_6 = Loft(
    Curves=[subset_11.List, subset_5.List],
    Options={Adjust=False, Closed=False, LoftEnds=0, LoftSimp=0, LoftType=0, Rebuild=10, Refit=0.01})
extr_5 = Extrude(Base=cluster_3, Direction=Z_5)
loft_7 = Loft(
    Curves=[subset_12.List, subset_6.List],
    Options={Adjust=False, Closed=False, LoftEnds=0, LoftSimp=0, LoftType=0, Rebuild=10, Refit=0.01})
extr_6 = Extrude(Base=cluster_4, Direction=Z_6)
join = BrepJoin(Breps=[extr_5, loft_6])  # -> Breps, Closed
join_2 = BrepJoin(Breps=[loft_2, extr])  # -> Breps, Closed
join_3 = BrepJoin(Breps=[loft_7, extr_6])  # -> Breps, Closed
join_4 = BrepJoin(Breps=[loft_5, extr_4])  # -> Breps, Closed
join_5 = BrepJoin(Breps=[loft_3, extr_2])  # -> Breps, Closed
join_6 = BrepJoin(Breps=[extr_3, loft_4])  # -> Breps, Closed

# ==== cluster Cluster
crv = ClusterInput()
num = ClusterInput()
crv_2 = ClusterInput()
crv_3 = Curve(crv)
crv_4 = Curve(crv_2)
ccx = CurveCurve(CurveA=crv_4, CurveB=crv_3)  # -> simplify(Points), ParamsA, ParamsB
null = NullItem(Item=ccx.Points)  # -> NullFlags, InvalidFlags, Description
L = ClusterInput()
dispatch = Dispatch(List=L, DispatchPattern=null.NullFlags)  # -> ListA, ListB
crv_5 = Curve(dispatch.ListB)
flatten = FlattenTree(Tree=crv_5, Path="{0}")
flatten_2 = FlattenTree(Tree=ccx.ParamsA, Path="{0}")
sort = SortList(Keys=flatten_2, ValuesA=flatten)  # -> Keys, ValuesA
lng = ListLength(List=sort.ValuesA)
num_2 = Number(num)
series = Series(Start=0, Step=num_2, Count=lng)
pt = ConstructPoint(XCoordinate=0, YCoordinate=0, ZCoordinate=series)
Z = UnitZ(Factor=pt)
move = Move(Geometry=sort.ValuesA, Motion=Z)  # -> Geometry, Transform
G = ClusterOutput(move.Geometry)
